# Grasshopper definition apsmith_hvonrint_gh.script.gh (Grasshopper 1.0.7)
# plug-ins: Kangaroo2 Components

# ---- group: KEY
# SUN SIMULATION:
# TURN ON PREVIEW TO VIEW COLOR CODED SUN ANALYSIS DATA ON PANELS
panel = Panel("NOTES AND INSTRUCTIONS")
panel_2 = Panel("KEY:")
panel_3 = Panel("COMPUTATIONAL PARAMETERS")
panel_4 = Panel("INTERNALIZED GEOMETRY")

# ---- group: Space Frame Parameters
bay_quantity = Slider(4, range=0..20)
row_quantity = Slider(14, range=0..50)
frame_depth = Slider(2, range=0..2)

# ----
crv = Curve(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)

# ---- group: LB Solar Analysis / Weather File
panel_5 = Panel("http://climate.onebuilding.org/WMO_Region_4_North_and_Central_America/USA_United_States_of_America/PA_Pennsylvania/USA_PA_Pittsburgh-Allegheny.County.AP.725205_TMY3.zip")
downloadepw = LBDownloadWeather(weather_URL=panel_5)  # -> epw_file, stat_file, ddy_file; plug-in component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
importloc = LBImportLocation(epw_file=downloadepw.epw_file)  # -> location; plug-in component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

# ---- group: LB Solar Analysis / Time Range
months = Slider(8, range=1..12)
day = Slider(1, range=1..31)
months_2 = Slider(5, range=1..12)
# MADE SITE CONTEXT AND A BASE MAP TO RUN THE SIMULTAION
day_2 = Slider(31, range=1..31)
analysisperiod = LBAnalysisPeriod(start_month=months, start_day=1, start_hour=0, end_month=months_2, end_day=day_2)  # -> period, hoys, dates; plug-in component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

# ---- group: LB Solar Analysis / Time Set
months_3 = Slider(4, range=1..12)
day_3 = Slider(28, range=1..31)
total_hours = Slider(20, range=1..25)
sun_hours = Slider(18, range=7..18)
hoy = LBCalculateHOY(month=months_3, day=day_3, hour=sun_hours)  # -> flatten(hoy), flatten(doy), flatten(date); plug-in component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

# ----
geometry = Geometry([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])

# ---- group: Analysis
sunpath = LBSunPath(location=importloc, hoys=hoy.hoy, scale=1)  # -> out, vectors, altitudes, azimuths, hoys, sun_pts, analemma, daily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; plug-in component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
context = Geometry([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])
directsunhours = LBDirectSunHours(
    vectors=flatten(sunpath.vectors),
    geometry=flatten(geometry),
    context=flatten(context),
    grid_size="2500",
    offset_dist="2000",
    run=Toggle(True))  # -> out, points, results, mesh, legend, title, int_mtx; plug-in component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

# ---- group: Base Map
base_grid = Geometry(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)
directsunhours_2 = LBDirectSunHours(
    vectors=flatten(sunpath.vectors),
    geometry=flatten(base_grid),
    context=flatten(context),
    grid_size="500",
    offset_dist="2000",
    run=Toggle(True))  # -> out, points, results, mesh, legend, title, int_mtx; plug-in component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

# ----
point = Point(sunpath.sun_pts)

# ---- group: Primary Frame
Y = UnitY(Factor=1)
amp = Amplitude(Vector=Y, Amplitude="20")
extr = Extrude(Base=crv, Direction=amp)
flip = Flip(Surface=extr)  # -> Surface, Result
sdivide = DivideSurface(Surface=flip.Surface, UCount=bay_quantity, VCount=row_quantity)  # -> Points, Normals, Parameters
offset = OffsetSurface(Surface=flip.Surface, Distance=frame_depth, Retrim=True)
sdivide_2 = DivideSurface(Surface=offset, UCount=bay_quantity, VCount=row_quantity)  # -> Points, Normals, Parameters
python = GhPythonScript(x=bay_quantity)  # -> out, a; inputs x: Int32
# ---------- python: Python ----------
__author__ = "Henry"
__version__ = "2021.10.24"

a=[]

for n in range(x):
    a.append(True)

z=1000

for n in range(z):
    a.append(False)

print(a)

##I am so proud I got this component to work
# ---------- end python ----------
flip_2 = FlipMatrix(Data=sdivide_2.Points)
cull = CullPattern(List=flip_2, CullPattern=python.a)
flip_3 = FlipMatrix(Data=cull)

# ---- group: Outer Frame
python_2 = GhPythonScript(x=bay_quantity)  # -> out, a; inputs x: Int32
# ---------- python_2: Python ----------
__author__ = "Henry"
__version__ = "2021.10.24"

a=[]

for n in range(x+1):
    a.append(True)

z=1000

for n in range(z):
    a.append(False)

print(a)

##I am so proud I got this component to work
# ---------- end python_2 ----------
flip_4 = FlipMatrix(Data=sdivide.Points)
cull_2 = CullPattern(List=flip_4, CullPattern=python_2.a)
item = ListItem(List=cull_2, Index=0, Wrap=True)  # -> Item, Item1
flip_5 = FlipMatrix(Data=cull_2)
dist = Distance(PointA=item.Item, PointB=item.Item1)  # -> flatten(Distance)
Y_2 = UnitY(Factor=1)
amp_2 = Amplitude(Vector=Y_2, Amplitude=expr("x/2", dist))

# ---- group: Primary Frame (continued)
move = Move(Geometry=flip_3, Motion=amp_2)  # -> Geometry, Transform

# ---- group: Frame Members
panel_6 = Panel("""{0}[-1]
{-1}[0]""")
relitem = RelativeItem(Tree=simplify(flip_5), Offset=panel_6, WrapPaths=False, WrapItems=False)  # -> ItemA, ItemB
relitem_2 = RelativeItem(Tree=simplify(move.Geometry), Offset="{0}[-1]", WrapPaths=False, WrapItems=False)  # -> ItemA, ItemB
ln = Line(StartPoint=relitem.ItemA, EndPoint=relitem.ItemB)
ln_2 = Line(StartPoint=relitem_2.ItemA, EndPoint=relitem_2.ItemB)
python_3 = GhPythonScript(x=bay_quantity)  # -> out, a; inputs x: Int32; same code as python
eval = EvaluateCurve(Curve=ln_2, Parameter=Slider(0, range=0..1))  # -> Point, Tangent, Angle
flip_6 = FlipMatrix(Data=eval.Point)
cull_3 = CullPattern(List=flip_6, CullPattern=python_3.a)
relitem_3 = RelativeItem(Tree=simplify(cull_3), Offset="{1}[0]", WrapPaths=False, WrapItems=False)  # -> ItemA, ItemB
flip_7 = FlipMatrix(Data=cull_3)
ln_3 = Line(StartPoint=relitem_3.ItemA, EndPoint=relitem_3.ItemB)

# ---- group: Panel Points
flip_8 = FlipMatrix(Data=flip_5)
culln = CullNth(List=flip_8, CullFrequency=expr("x+1", bay_quantity))
flip_9 = FlipMatrix(Data=culln)

# ---- group: Frame Members
panel_7 = Panel("""{0}[0]
{0}[-1]
{-1}[0]
{-1}[-1]""")
relitem2 = RelativeItems(TreeA=simplify(flip_5), TreeB=simplify(flip_7), Offset=panel_7, WrapPaths=False, WrapItems=False)  # -> ItemA, ItemB
ln_4 = Line(StartPoint=relitem2.ItemA, EndPoint=relitem2.ItemB)
diagonal_components = Line(ln_4)

# ---- group: Panel Points
flip_10 = FlipMatrix(Data=flip_5)
shift = ShiftList(List=flip_9, Shift="1", Wrap=False)
shift_2 = ShiftList(List=eval.Point, Shift="1", Wrap=False)
shift_3 = ShiftList(List=flip_10, Shift="1", Wrap=False)
flip_11 = FlipMatrix(Data=shift_3)
flip_12 = FlipMatrix(Data=shift_3)
shift_4 = ShiftList(List=flip_12, Shift="1", Wrap=False)

# ----
crv_2 = Curve([diagonal_components, ln_3, ln])

# ---- group: Panel Surfaces
srf4pt = _4PointSurface(CornerA=shift, CornerB=shift_2, CornerC=eval.Point)
srf4pt_2 = _4PointSurface(CornerA=flip_5, CornerB=eval.Point, CornerC=flip_11)
srf4pt_3 = _4PointSurface(CornerA=eval.Point, CornerB=flip_9, CornerC=shift)
srf4pt_4 = _4PointSurface(CornerA=flip_11, CornerB=eval.Point, CornerC=shift_4)
srf4pt_5 = _4PointSurface(CornerA=shift_4, CornerB=eval.Point, CornerC=shift_2)

# ----
list_item = ListItem(List=srf4pt_2, Index=0, Wrap=True)

# ---- group: Frame
member_thickness = Slider(0.05, range=0..0.1)
end_offset = Slider(0.01, range=0..0.1)
segment = Slider(0.2, range=0..1)
multipipe = MultiPipe(
    Curves=crv_2,
    NodeSize=member_thickness,
    EndOffset=end_offset,
    StrutSize=1,
    Segment=segment,
    KinkAngle=0.6,
    CubeFit=Toggle(False),
    Caps=0)
scale = Scale(Geometry=multipipe, Center=Point(0, 0, 0), Factor="50")  # -> Geometry, Transform

# ---- group: Panels
# NEED TO BAKE PANELS TO RUN LADYBUG SUN ANALYSIS
scale_2 = Scale(Geometry=[srf4pt_3, srf4pt_4, srf4pt_5, srf4pt, list_item], Center=Point(0, 0, 0), Factor="50")  # -> Geometry, Transform

# ---- group: Shading Devices
edges = BrepEdges(Brep=geometry)  # -> simplify(Naked), Interior, NonManifold
evalsrf = EvaluateSurface(Surface=reparameterize(flatten(geometry)), Point="0.5,0.5")  # -> Point, Normal, UDirection, VDirection, Frame
pframe = PerpFrame(Curve=reparameterize(edges.Naked), Parameter="0.5")
area = Area(Geometry=geometry)  # -> Area, Centroid
point_2 = Point(area.Centroid)
ln_5 = Line(StartPoint=graft(point_2), EndPoint=pframe)
dist_2 = Distance(PointA=graft(point_2), PointB=pframe)
pl = ConstructPlane(Origin=pframe, XAxis=simplify(ln_5), YAxis=graft(evalsrf.Normal))
cir = Circle(Plane=simplify(pl), Radius=simplify(dist_2))
end = EndPoints(Curve=edges.Naked)  # -> Start, End

# ---- group: Solar Tracking
ln_6 = Line(StartPoint=point_2, EndPoint=point)
angle = Angle(VectorA=ln_6, VectorB=evalsrf.Normal)  # -> Angle, Reflex
bnd = Bounds(Numbers=angle.Angle)
dom = ConstructDomain(DomainStart=Slider(0.3, range=0..1), DomainEnd=Slider(0.5, range=0..1))
remap = RemapNumbers(Value=angle.Angle, Source=bnd, Target=dom)  # -> Mapped, Clipped
partition = PartitionList(List=remap.Mapped, Size="3")

# ---- group: Shading Devices (continued)
eval_2 = EvaluateCurve(Curve=reparameterize(cir), Parameter=partition)  # -> Point, Tangent, Angle
shading_device = _4PointSurface(CornerA=end.Start, CornerB=end.End, CornerC=eval_2.Point)

# ---- group: Final Colors
studio_project_color = CustomPreview(Geometry=scale.Geometry, Material=ColourSwatch(SwatchColor=RGB(30, 82, 0)))
studio_project_color_2 = CustomPreview(Geometry=shading_device, Material=ColourSwatch(SwatchColor=RGB(0, 0, 0)))
studio_project_color_3 = CustomPreview(Geometry=scale_2.Geometry, Material=ColourSwatch(SwatchColor=RGBA(199, 199, 199, 168)))
