# Grasshopper definition Anqi_Alexandra_Final_Model_script.gh (Grasshopper 1.0.7)
# plug-ins: LunchBox

srf_4_21 = Surface(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)

# ---- group: sun path
crv_sun_path = Curve(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)
eval = EvaluateCurve(Curve=reparameterize(crv_sun_path), Parameter=Slider(1, range=0..1))  # -> Point, Tangent, Angle

# ----
srf_ground = Surface(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)
chairs = Geometry([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])
human = Geometry(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)

srf = Surface(srf_4_21)

number_slider = Slider(10, range=0..10)
number_slider_2 = Slider(24, range=0..100)
divide = DivideDomain²(Domain=srf, UCount=number_slider, VCount=number_slider_2)
sdivide = DivideSurface(Surface=srf, UCount=number_slider, VCount=number_slider_2)  # -> Points, Normals, Parameters
subsrf = Isotrim(Surface=srf, Domain=divide)
evalsrf = EvaluateSurface(Surface=reparameterize(subsrf), Point="{0.5,0.5,0}")  # -> Point, Normal, UDirection, VDirection, Frame
explode = Explode(Curve=subsrf, Recursive=True)  # -> Segments, Vertices
amp = Amplitude(Vector=evalsrf.Normal, Amplitude=Slider(0.8, range=0..10))
move = Move(Geometry=evalsrf.Point, Motion=amp)  # -> Geometry, Transform
partition = PartitionList(List=move.Geometry, Size=number_slider_2)

# ---- group: construct diamond geometries
neg = Negative(Value=Slider(0.1, range=0..1))
offset = OffsetSurface(Surface=srf, Distance=neg, Retrim=True)
diamond = DiamondPanels(Surface=offset, UDivisions=number_slider, VDivisions=number_slider_2)  # -> DiamondPanels, TriPanels

# ----
pt_sun_location = Point(eval.Point)

number_slider_3 = Slider(0.2, range=0..1)
box = CenterBox(Base=move.Geometry, X=number_slider_3, Y=number_slider_3, Z=Slider(0.12, range=0..1))

area = Area(Geometry=[diamond.DiamondPanels, diamond.TriPanels])  # -> Area, graft(Centroid)

# ---- group: find distance between sun position and center of each diamond
srf_cp = SurfaceClosestPoint(Point=area.Centroid, Surface=offset)  # -> Point, UVPoint, Distance
evalsrf_2 = EvaluateSurface(Surface=offset, Point=srf_cp.UVPoint)  # -> Point, Normal, UDirection, VDirection, Frame
surf_pts = Point(flatten(evalsrf_2.Point))
dist = Distance(PointA=surf_pts, PointB=pt_sun_location)  # -> flatten(Distance)

# ----
flip = FlipMatrix(Data=sdivide.Points)
flip_2 = FlipMatrix(Data=partition)
ln = Line(StartPoint=explode.Vertices, EndPoint=graft(move.Geometry))
intcrv = Interpolate(Vertices=flip_2, Degree=3, Periodic=False, KnotStyle=1)  # -> Curve, Length, Domain
intcrv_2 = Interpolate(Vertices=partition, Degree=3, Periodic=False, KnotStyle=1)  # -> Curve, Length, Domain
intcrv_3 = Interpolate(Vertices=sdivide.Points, Degree=3, Periodic=False, KnotStyle=1)  # -> Curve, Length, Domain
intcrv_4 = Interpolate(Vertices=flip, Degree=3, Periodic=False, KnotStyle=1)  # -> Curve, Length, Domain
pipe = Pipe(Curve=[intcrv.Curve, intcrv_2.Curve, ln], Radius=Slider(0.05, range=0..2), Caps=2)
pipe_2 = Pipe(Curve=[intcrv_3.Curve, intcrv_4.Curve], Radius=Slider(0.05, range=0..2), Caps=2)

# ---- group: compare distance
larger = LargerThan(FirstNumber=dist, SecondNumber=Slider(66, range=0..1000))  # -> LargerThan, OrEqualTo

# ----
crv = Curve(graft(diamond.DiamondPanels))

# ---- group: if distance < set number, diamond shrinks
flatten = FlattenTree(Tree=area.Centroid, Path="{0}")
dispatch = Dispatch(List=dist, DispatchPattern=larger.OrEqualTo)  # -> ListA, ListB
dispatch_2 = Dispatch(List=flatten, DispatchPattern=larger.OrEqualTo)  # -> ListA, ListB
bnd = Bounds(Numbers=dispatch.ListA)
dom = ConstructDomain(DomainStart=Slider(0.15, range=0..1), DomainEnd=Slider(1, range=0..1))
remap = RemapNumbers(Value=dispatch.ListA, Source=bnd, Target=dom)  # -> Mapped, Clipped

# ---- group: construct diamond geometry and panels
flatten_2 = FlattenTree(Tree=crv, Path="{0}")
dispatch_3 = Dispatch(List=flatten_2, DispatchPattern=larger.OrEqualTo)  # -> ListA, ListB
scale = Scale(Geometry=dispatch_3.ListA, Center=dispatch_2.ListA, Factor=remap.Mapped)  # -> Geometry, Transform
crv_2 = Curve(simplify(graft(crv)))
weave = Weave(Pattern=larger.OrEqualTo, Stream0=dispatch_3.ListB, Stream1=scale.Geometry, NullGaps=False)  # -> simplify(graft(Weave))
Y = UnitY(Factor=Slider(-1, range=-100..101))
move_2 = Move(Geometry=weave, Motion=Y)  # -> simplify(Geometry), Transform
loft = Loft(
    Curves=[crv_2, move_2.Geometry],
    Options={Adjust=False, Closed=False, LoftEnds=0, LoftSimp=0, LoftType=0, Rebuild=10, Refit=0.01})
