# Grasshopper definition script.gh (Grasshopper 1.0.7)
# plug-ins: Pufferfish, Weaverbird, Kangaroo2 Components

# ---- group: Step 0: Mesh conversion
# Plugin Libraries Used: Pufferfish | ver: 3.0.0.0
# Weaverbird | ver: 0.9.0.1
# Kangaroo2 Components | ver: 2.5.3
# All Components Used: Tue Apr 26 23:17:58 2022
# Last saved by - andre
# Total Components - 58
# Pufferfish:
# ...Mesh:
# ......Offset Mesh - 1
# ...Surface:
# ......Mesh To Polysurface - 1
# Vector:
# ...Vector:
# ......Unit Z - 1
# Params:
# ...Primitive:
# ......File Path - 1
# ...Geometry:
# ......Brep - 12
# ......Line - 1
# ......Mesh - 3
# ...Util:
# ......Relay - 2
# ......Cluster - 3
# ...Input:
# ......Boolean Toggle - 2
# ......Number Slider - 4
# ......Panel - 2
# ......Button - 1
# Mesh:
# ...Util:
# ......Mesh Brep - 1
# ...Analysis:
# ......Face Boundaries - 1
# ......Mesh Edges - 1
# ......Deconstruct Mesh - 3
# Ladybug:
# ...0 :: Import:
# ......LB Import EPW - 1
# ...1 :: Analyze Data:
# ......LB Analysis Period - 1
# ...2 :: Visualize Data:
# ......LB Cumulative Sky Matrix - 1
# ...3 :: Analyze Geometry:
# ......LB Incident Radiation - 1
# Curve:
# ...Primitive:
# ......Line - 3
# ...Analysis:
# ......End Points - 1
# Transform:
# ...Euclidean:
# ......Move - 1
# Maths:
# ...Operators:
# ......Multiplication - 1
# ...Script:
# ......Mesh Explode - 1
# ......GhPython Script - 1
# ...Domain:
# ......Construct Domain - 1
# ......Bounds - 1
# ......Remap Numbers - 1
# Wb:
# ...SubD:
# ......Weaverbird's Split Triangles Subdivision - 1
# OTools:
# ...6 | WIP:
# ......OGetUsedComps_SDKMode - 1
# Surface:
# ...SubD:
# ......MultiPipe - 1
input_brep = Brep(<brep referenced from the Rhino model>)
mesh = MeshBrep(
    Brep=input_brep,
    Settings={GridMaxCount=0, GridMinCount=16, JaggedSeams=False, MaxEdgeLength=0, MinEdgeLength=4, MinTolerance=0, Refine=True, RefineAngle=0, RelativeTolerance=0.65, SimplePlanes=True, Tolerance=0})
wbtriangles = WeaverbirdsSplitTrianglesSubdivision(MeshCurves=mesh, Level=Slider(1, range=0..10))
mesh_2 = Mesh(wbtriangles)

# ---- group: Step 1: Ladybug Simulation / Load weather data
path = FilePath("C:\Users\andre\Downloads\USA_PA_Pittsburgh-Allegheny.County.AP.725205_TMY3.epw")
importepw = LBImportEPW(epw_file=path)  # -> location, dry_bulb_temperature, dew_point_temperature, relative_humidity, wind_speed, wind_direction, direct_normal_rad, diffuse_horizontal_rad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; plug-in component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

# ---- group: Step 1: Ladybug Simulation / Process weather data based on time
analysisperiod = LBAnalysisPeriod(start_month=1, start_day=1, start_hour=0)  # -> period, hoys, dates; plug-in component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
skymatrix = LBCumulativeSkyMatrix(
    location=importepw.location,
    direct_rad=importepw.direct_normal_rad,
    diffuse_rad=importepw.diffuse_horizontal_rad,
    hoys=analysisperiod.hoys)  # -> report, sky_mtx; plug-in component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

# ---- group: Step 1: Ladybug Simulation / Ladybug Incident Radiation Analysis
run_incident_radiation_analysis = BooleanToggle(True)
surrounding_buildings = Mesh(<mesh referenced from the Rhino model>)
base_geometry = Mesh(mesh_2)
incidentradiation = LBIncidentRadiation(
    sky_mtx=skymatrix.sky_mtx,
    geometry=graft(base_geometry),
    context=flatten(surrounding_buildings),
    grid_size="0.5",
    parallel=base_geometry,
    run=run_incident_radiation_analysis)  # -> report, points, flatten(results), total, mesh, legend, title, int_mtx; plug-in component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

# ---- group: Tertiary framing
frame_thickness = Slider(2, range=0..10)
offset_mesh = OffsetMesh(Mesh=mesh_2, Distance=expr("-x", frame_thickness), BothSides=0, CreateSolid=Toggle(False))
mesh_edges = MeshEdges(Mesh=offset_mesh)  # -> NakedEdges, InteriorEdges, NonManifoldEdges
deconstruct_mesh = DeconstructMesh(Mesh=offset_mesh)  # -> Vertices, Faces, Colours, Normals
deconstruct_mesh_2 = DeconstructMesh(Mesh=mesh_2)  # -> Vertices, Faces, Colours, Normals
cluster = Cluster(point=deconstruct_mesh.Vertices)
line = Line([mesh_edges.NakedEdges, mesh_edges.InteriorEdges])
end_points = EndPoints(Curve=line)  # -> Start, End
line_2 = Line(StartPoint=cluster, EndPoint=deconstruct_mesh_2.Vertices)
cluster_2 = Cluster(point=end_points.Start)
cluster_3 = Cluster(point=end_points.End)
line_3 = Line(StartPoint=cluster_2, EndPoint=cluster_3)

# ----
m_explode = MeshExplode(M=mesh_2, N=True)  # -> out, A; inputs M: Mesh
# ---------- m_explode: VB ----------
    Component.Params.Input(0).Name = "Mesh"
    Component.Params.Input(0).Description = "Open or closed mesh"
    Component.Params.Input(1).Name = "Modify Normals"
    Component.Params.Input(1).Description = "An optional boolean that specifies whether vertex normals will be maintained if false or recalculated with the new face"

    Component.Params.Output(1).Name = "Mesh"
    Component.Params.Output(1).Description = "If successful, a list of valid meshes"

    If m IsNot Nothing Then
      Dim i As Integer

      Dim clrB As Boolean
      Dim mshs As New list(Of mesh)
      Dim mf As Rhino.Geometry.Collections.MeshFaceList = Nothing
      Dim mv As Rhino.Geometry.Collections.MeshVertexList = Nothing
      Dim mn As Rhino.Geometry.Collections.MeshVertexNormalList = Nothing
      Dim mc As Rhino.Geometry.Collections.MeshVertexColorList = Nothing

      If m.VertexColors.count() > 0 Then clrB = True Else m.VertexColors.CreateMonotoneMesh(color.White)
      If m.Normals.Count() < 1 Then m.Normals.ComputeNormals()
      mf = m.Faces
      mv = m.Vertices
      mn = m.Normals
      mc = m.VertexColors

      For i = 0 To mf.Count() - 1 Step 1
        Dim pts As New list(Of point3d)
        Dim fc As New meshFace
        Dim clr As New list(Of Color)
        Dim vec As New list(Of Vector3f)
        Dim msh As New mesh

        pts.add(New point3d(mv(mf(i).A)))
        pts.add(New point3d(mv(mf(i).B)))
        pts.add(New point3d(mv(mf(i).C)))
        If mf(i).IsQuad Then pts.add(New point3d(mv(mf(i).D)))

        clr.add(mc(mf(i).A))
        clr.add(mc(mf(i).B))
        clr.add(mc(mf(i).C))
        If mf(i).IsQuad Then clr.add(mc(mf(i).D))

        If N Then
          vec.add(mn(mf(i).A))
          vec.add(mn(mf(i).B))
          vec.add(mn(mf(i).C))
          If mf(i).IsQuad Then vec.add(mn(mf(i).D))
        End If

        If mf(i).IsQuad Then fc = New meshFace(0, 1, 2, 3) Else fc = New meshface(0, 1, 2)

        msh.Vertices.AddVertices(pts.toarray())
        msh.Faces.AddFace(fc)
        If clrB Then msh.VertexColors.AppendColors(clr.toarray())
        If N Then msh.Normals.AddRange(vec.toarray()) Else msh.Normals.ComputeNormals()
        mshs.add(msh)
      Next

      A = mshs
    End If
# ---------- end m_explode ----------

# ---- group: Primary framing
faceb = FaceBoundaries(Mesh=mesh_2)

# ---- group: Create and sort panels by radiation value
dom = ConstructDomain(DomainStart=0, DomainEnd=1)
bnd = Bounds(Numbers=incidentradiation.results)
remap = RemapNumbers(Value=incidentradiation.results, Source=bnd, Target=dom)  # -> Mapped, Clipped
msh2psrf = MeshToPolysurface(Mesh=m_explode.A, Triangles=False, FaceMerge=False)  # -> flatten(Polysurface)
panelsort = GhPythonScript(values=remap.Mapped, panels=msh2psrf)  # -> out, zero, one, two, three, four, five, six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; inputs values: list, panels: list
# ---------- panelsort: Python ----------
__author__ = "Lenovo"
__version__ = "2022.03.28"

import rhinoscriptsyntax as rs
import ghpythonlib.components as ghcomp
# import ghpythonlib.treehelpers as th

zero = []
one = []
two = []
three = []
four = []
five = []
six = []
seven = []
eight = []
nine = []
ten = []
for i in range(len(values)):
    if values[i] < 0.1:
        zero.append(panels[i])
    elif values[i] >= 0.1 and values[i] < 0.2:
        one.append(panels[i])
    elif values[i] >= 0.2 and values[i] < 0.3:
       two.append(panels[i])
    elif values[i] >= 0.3 and values[i] < 0.4:
       three.append(panels[i])
    elif values[i] >= 0.4 and values[i] < 0.5:
       four.append(panels[i])
    elif values[i] >= 0.5 and values[i] < 0.6:
       five.append(panels[i])
    elif values[i] >= 0.6 and values[i] < 0.7:
       six.append(panels[i])
    elif values[i] >= 0.7 and values[i] < 0.8:
       seven.append(panels[i])
    elif values[i] >= 0.8 and values[i] < 0.9:
       eight.append(panels[i])
    elif values[i] >= 0.9 and values[i] < 1.0:
       nine.append(panels[i])
    else:
       ten.append(panels[i])
# ---------- end panelsort ----------

# ---- group: Secondary framing
demesh = DeconstructMesh(Mesh=m_explode.A)  # -> Vertices, Faces, Colours, Normals
Z = UnitZ(Factor=1)
multiplication = Multiplication(A=Slider(2, range=0..10, expression="x*-1"), B=Z)
move = Move(Geometry=incidentradiation.points, Motion=multiplication)  # -> Geometry, Transform
ln = Line(StartPoint=graft(move.Geometry), EndPoint=demesh.Vertices)

# ---- group: Panels
brep = Brep(panelsort.zero)
brep_2 = Brep(panelsort.one)
brep_3 = Brep(panelsort.two)
brep_4 = Brep(panelsort.four)
brep_5 = Brep(panelsort.five)
brep_6 = Brep(panelsort.six)
brep_7 = Brep(panelsort.seven)
brep_8 = Brep(panelsort.eight)
brep_9 = Brep(panelsort.nine)
brep_10 = Brep(panelsort.three)
brep_11 = Brep(panelsort.ten)

# ----
pipe_thickness = Slider(0.05, range=0..0.1)

# ---- group: Space frame
mp = MultiPipe(
    Curves=[line_2, line_3, faceb, ln],
    NodeSize=pipe_thickness,
    EndOffset=1,
    StrutSize=1,
    Segment=0,
    KinkAngle=0.6,
    CubeFit=0,
    Caps=0)

# ==== cluster Cluster
point = ClusterInput()
deconstruct = Deconstruct(Point=point)  # -> XComponent, YComponent, ZComponent
bounds = Bounds(Numbers=deconstruct.ZComponent)
point_2 = Point(Point(0, 0, 0))
deconstruct_2 = Deconstruct(Point=point_2)  # -> XComponent, YComponent, ZComponent
deconstruct_domain = DeconstructDomain(Domain=bounds)  # -> Start, End
construct_domain = ConstructDomain(DomainStart=deconstruct_2.ZComponent, DomainEnd=deconstruct_domain.End)
remap_numbers = RemapNumbers(Value=deconstruct.ZComponent, Source=bounds, Target=construct_domain)  # -> Mapped, Clipped
construct_point = ConstructPoint(XCoordinate=deconstruct.XComponent, YCoordinate=deconstruct.YComponent, ZCoordinate=remap_numbers.Mapped)
point_3 = ClusterOutput(construct_point)
